# Grasshopper definition AIA_GeoOpt_Assignment02_setup.gh (Grasshopper 1.0.7)

panel = Panel("https://raw.githubusercontent.com/Fromero8706/AIA---GeoOpt/main/A1/test.py")
python = GhPythonScript(fetch=Button(), url=panel)  # -> out, raw; inputs fetch: Boolean
# ---------- python: Python ----------
"""Provides a scripting component that fetches the python code from a github repository.
    Inputs:
        fetch: Boolean to fetch
        url: The url of the raw python file in github
    Output:
        raw: Outputs the code"""

__author__ = "davidandresleon"
__version__ = "2021.04.04"


import clr
clr.AddReference('System.Web.Extensions')
from System.Web.Script.Serialization import JavaScriptSerializer
from System.Net import WebClient


if fetch:

    # Create a web client
    client = WebClient()
    
    # Download the results of that URL
    results = client.DownloadString(url)
    # output these results
    
raw =  results
# ---------- end python ----------
# Assignment 2
python_2 = GhPythonScript(x=Slider(10, range=1..20), y=Slider(10, range=1..20), U=Slider(20, range=1..20), V=Slider(20, range=1..20))  # -> out, a, c, d, e, f, g, h; inputs x: Int32, U: Int32, V: Int32
# ---------- python_2: Python ----------
import Rhino.Geometry as rg
import ghpythonlib.treehelpers as th
import math
import ghpythonlib.components as ghc

#this is how you initialize a list in python
pointList1 = []
pointList2 = []
for i in range(x):
    pt1 = rg.Point3d(i, 0, 0)
    pt2 = rg.Point3d(i, y, 0)
    pointList1.append(pt1)
    pointList2.append(pt2)

a = pointList1

lineList = []
for i in range(len(pointList1)):
    line = rg.Line(pointList1[i], pointList2[i])
    lineList.append(line)
c = lineList


allDivPts = []
for l in lineList:
    divPts = [] #my list of division points
    nc = l.ToNurbsCurve()
    params = nc.DivideByCount(V, True)
    for p in params:
        divPt = nc.PointAt(p)
        
        vec= rg.Vector3d(divPt)
        vecLen = vec.Length
        mag = math.sin(vecLen)
        transVec = -rg.Vector3d.ZAxis * mag
        
        newPt = divPt - transVec
        divPts.append(newPt)

    allDivPts.append(divPts)

d = th.list_to_tree(allDivPts)


#make a curve from list of points
curveList = []
for i in range(len(allDivPts)):
    curve = rg.Curve.CreateInterpolatedCurve(allDivPts[i], 3)
    curveList.append(curve)
e= curveList


#create a loft surface from curves
surface = rg.Brep.CreateFromLoft(curveList, rg.Point3d.Unset, rg.Point3d.Unset, rg.LoftType.Normal, False)
surface = surface[0].Faces[0]

f = surface

#reparametrize surface
surface.SetDomain(0,rg.Interval(0,U))
surface.SetDomain(1,rg.Interval(0,V))

#get points
allSrfPts=[]
for i in range(U+1):
    srfPts= []
    for j in range(V+1):
        pt=rg.Surface.PointAt(surface,i,j)
        srfPts.append(pt)
    allSrfPts.append(srfPts)
h = allSrfPts


mesh = rg.Mesh()
for i in range(len(allSrfPts)-1):
    for j in range(len(allSrfPts[i])-1):
        m = rg.Mesh()
        v1 = allSrfPts[i][j]
        v2 = allSrfPts[i][j+1]        
        v3 = allSrfPts[i+1][j+1]        
        v4 = allSrfPts[i+1][j]
        
        m.Vertices.Add(v1)
        m.Vertices.Add(v2)
        m.Vertices.Add(v3)
        m.Vertices.Add(v4)
        
        m.Faces.AddFace(0,1,2,3)
        
        mesh.Append(m)

g = mesh

cleanmesh = mesh
#methods to clean a mesh
cleanmesh.Normals.ComputeNormals()
cleanmesh.Vertices.CombineIdentical(True, True)
cleanmesh.Vertices.CullUnused()
cleanmesh.Weld(3.14159265358979)
cleanmesh.UnifyNormals()
cleanmesh.FaceNormals.ComputeFaceNormals()
cleanmesh.Compact()


h = cleanmesh
# ---------- end python_2 ----------
python_3 = GhPythonScript(Code=python.raw)  # -> Out, A
python_4 = GhPythonScript()  # -> out, a, b, c; disabled
# ---------- python_4: Python ----------
import Rhino.Geometry as rg
import rhinoscriptsyntax as rs
import math

#create a sun vector

#1. create a Sphere at point (0,0,0) with radius 1 and output it to a
#output the sphere to a

#a = sphere

center = rg.Point3d(0, 0, 0)
print center
a = rg.Sphere(center, 1)

# How can I coerce the Sphere to Surface
# a = rg.coerceSurface(a) not working
# a = rg.Surface.SetDomain(a, 0, rg.Interval(0,1))


#2. evaluate a point in the sphere using rg.Sphere.PointAt() at coordintes x and y
#the point should only be on the upper half of the sphere (upper hemisphere)
#the angles are in radians, so you might want to use math.pi for this
#output the point to b

#b = point on the sphere

b = rg.Sphere.PointAt(a, x, y)

print b
print type(b)


#create a vector from the origin  and reverse the vector
#keep in mind that Reverse affects the original vector
#output the vector to c


#c = vector



c = rs.CreateVector(b)
c = rg.Vector3d.Negate(c)
print c
print type(c)
# ---------- end python_4 ----------

# ---- group: create sun Vector
python_5 = GhPythonScript(x=Slider(0, range=0..1), y=Slider(0.24, range=0..1))  # -> out, a, b, c
# ---------- python_5: Python ----------
import Rhino.Geometry as rg
import math
import rhinoscriptsyntax as rs

#create a sun vector

#1. create a Sphere at point (0,0,0) with radius 1 and output it to a
#output the sphere to a

#a = sphere
center = rg.Point3d(0,0,0)
print (center)
a = rg.Sphere(center,1)

#2. evaluate a point in the sphere using rg.Sphere.PointAt() at coordintes x and y
#the point should only be on the upper half of the sphere (upper hemisphere)
#the angles are in radians, so you might want to use math.pi for this
#output the point to b

#b = point
b = rg.Sphere.PointAt(a, x*2*math.pi, y*math.pi)
c = math.pi*b*2
print(b)


#create a vector from the origin  and reverse the vector
#keep in mind that Reverse affects the original vector
#output the vector to c

#c = vec
c = rg.Vector3d(b)
c = rg.Vector3d.Negate(c)
print(c)
# ---------- end python_5 ----------

# ---- group: replaceable mesh
mesh = Data(python_2.h)

# ---- group: your .py file goes here
path = FilePath("C:\Users\kimky\Desktop\AIA-GeoOpt\AIA-GeoOpt\a01\Assignment 02.py")

# ----
file = ReadFile(File=path, PerLineParse=True)
vdis = VectorDisplay(Anchor=python_5.b, Vector=python_5.c)
python_6 = GhPythonScript(m=mesh, s=python_5.c)  # -> out, a, b, c, d, E; inputs m: Mesh, s: Vector3d
# ---------- python_6: Python ----------
import Rhino.Geometry as rg

#1.
#compute face normals using rg.Mesh.FaceNormals.ComputeFaceNormals()
#output the vectors to a

#a = faceNormals
a = []
num_faces = len(m.Faces)
#print(num_face)
for i in range(num_faces):
    normalsFace= m.FaceNormals[i]
    reverse_norm=rg.Vector3d.Negate(normalsFace)
    a.append(reverse_norm)
print type(a)


#2.
#get the centers of each faces using rg.Mesh.Faces.GetFaceCenter()
#store the centers into a list called centers 
#output that list to b
#b = centers

b = []
for j in range(num_faces):
    faceCenter= m.Faces.GetFaceCenter(j)
    b.append(faceCenter)
    


#3.
#calculate the angle between the sun and each FaceNormal using rg.Vector3d.VectorAngle()
#store the angles in a list called angleList and output it to c

#c = angleList

c = []
for k in range(num_faces):
    angle = rg.Vector3d.VectorAngle(a[i], s)
    c.append(angle)


#4. explode the mesh - convert each face of the mesh into a mesh
#for this, you have to first copy the mesh using rg.Mesh.Duplicate()
#then iterate through each face of the copy, extract it using rg.Mesh.ExtractFaces
#and store the result into a list called exploded in output d

#d = exploded

d = []
meshDupli = m.Duplicate()

for m in range(len(rg.Mesh.Duplicate(m).Faces)):
   faceMesh = meshDupli.Faces.ExtractFaces([0])
   d.append(faceMesh)


#after here, your task is to apply a transformation to each face of the mesh
#the transformation should correspond to the angle value that corresponds that face to it... 
#the result should be a mesh that responds to the sun position... its up to you!

"""
Bonus tasks include:
- Propose a different mesh to analyse
- Provide a frame for the resulting mesh by moving edges according to the rg.Mesh.VertexNormals
"""

""""Tries for bonus but not working-----------------------------------
import Rhino as rc

def meshEdgeLines(mesh):
    
    lines = []
    for s in range(mesh.Vertices.Count):
        neighbours = mesh.Vertices.GetConnectedVertices(i)
        for n in neighbours:
            if n > i:
                line = rc.Geometry.Line(mesh.Vertices.Item[i],mesh.Vertices.Item[n])
                lines.append(line)
                
    return lines


E = meshEdgeLines(m)
"""""

"""
e = []
for l in range(len(rg.Mesh.Duplicate(m).Faces)):
    edge = l.GetNakedEdges()
    list_edge.append(edge)
e.append(list_edge[s])
"""
# ---------- end python_6 ----------
bnd = Bounds(Numbers=python_6.c)
panel_2 = Panel(python_6.out)
dedomain = DeconstructDomain(Domain=bnd)  # -> Start, End
gradient = Gradient(
    LowerLimit=dedomain.Start,
    UpperLimit=dedomain.End,
    Parameter=python_6.c,
    stops=[0: RGB(234, 38, 0), 0.25: RGB(234, 126, 0), 0.5: RGB(254, 244, 84), 0.75: RGB(173, 203, 249), 1: RGB(75, 107, 169)])
vdis_2 = VectorDisplay(Anchor=python_6.b, Vector=python_6.a)
preview = CustomPreview(Geometry=python_6.d, Material=gradient)
